# Grasshopper definition export_from_karamba.gh (Grasshopper 1.0.7)
# plug-ins: LunchBox, karambaGH

curve = Curve([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])

# ---- group: Reference Geometry
# to apply to a new model:
# right-click and set multiple curves;
# 
# ** pay close attention to intersections of rhino curves;
# Karamba3D will not read joints if lines are not intersecting
curve_2 = Curve([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])
explode = Explode(Curve=curve, Recursive=True)  # -> flatten(Segments), Vertices
line_line_intersection_karamba3d = LineLineIntersectionKaramba(Line=explode.Segments, LengthTolerance=0.01)  # -> IntersectionPoints, flatten(LineSubSegements)

# ----
list_item = ListItem(List=curve, Index=0, Wrap=True)  # -> Item1, Item

# ---- group: Reference Geometry
# to apply to a new model:
# right-click and set multiple points;
# 
# ** points must be near intended supports;
# definition will automatically snap to closest node in model
point = Point([Point(7.338080932, 0.3633907323, 5.215597679), Point(-0.09269640327, 0.3633907323, 6.072995064), Point(-7.523473739, 0.3633907323, 4.882165363)])

# ----
point_2 = Point(Point(-0.09269640327, 0.3633907323, 6.072995064))

# ---- group: Reference Geometry
# to apply to a new model:
# right-click and set multiple points;
# 
# ** points must be near intended supports;
# definition will automatically snap to closest node in model
point_3 = Point(Point(-11.8471691, 0.3633907323, -0.4490884826))

# to apply to a new model:
# right-click and set multiple points;
# 
# ** points must be near intended supports;
# definition will automatically snap to closest node in model
point_4 = Point(Point(11.11202754, 0.3633907323, -0.7348876109))

# ----
number_slider = Slider(4, range=0..10)
curve_3 = Curve(list_item.Item)
curve_4 = Curve(list_item.Item1)
panel = Panel("6")
random_split_list = RandomSplitList(MasterList=line_line_intersection_karamba3d.LineSubSegements, Seed=number_slider, Split=0.5)  # -> ListA, ListB
split_list = SplitList(List=line_line_intersection_karamba3d.LineSubSegements, Index=number_slider)  # -> ListA, ListB
live_load = Slider(-10, range=-50..-0.04)
unit_y = UnitY(Factor=live_load)

# ---- group: Define Elements
# an ideal truss has hinged joints and
#  members carry only axial loads
boolean_toggle = BooleanToggle(False)  # disabled
panel_2 = Panel("beams")  # disabled
line_to_beam_karamba3d = LineToBeamKaramba3D(
    Line=line_line_intersection_karamba3d.LineSubSegements,
    Identifier=panel_2,
    New=True,
    Remove=True,
    LimitDistance_m=0.005,
    Bending=boolean_toggle)  # -> Element, Points, Info; disabled

# ----
point_5 = Point([Point(-10, 0, 0), Point(0, 0, 5), Point(10, 0, 0)])
element_karamba3d = ElementKaramba3D(line_to_beam_karamba3d.Element)
point_6 = Point(point_5)

# ---- group: Define Loads
# live load applied as uniform distributed (mesh) loads
# ** note: low mesh density can
# result in uneven distribution of load
live_load_2 = Slider(-10, range=-50..-0.04)
unit_z = UnitZ(Factor=live_load_2)
find_similar_member = FindSimilarMember(Data=point, Set=point_6)  # -> Hit, Index
unit_z_2 = UnitZ(Factor="-1")
loads_karamba3d = LoadsKaramba3D(Vector=unit_z_2, LCase=0, mode="Gravity")
loads_karamba3d_2 = LoadsKaramba3D(ForceVector=unit_z, Local=False, PosInd=find_similar_member.Hit, LCase=0, mode="Point")
load_karamba3d = LoadKaramba3D(flatten(loads_karamba3d_2))

# ---- group: Define Supports
# ROLLER support can translate in the x
# direction and rotate about the y axis
# PIN support cannot translate in any
# direction but  can rotate about the y axis
# out of plane support for all nodes:
# restrain all nodes out of plane for
# 2d analysis
find_similar_member_2 = FindSimilarMember(Data=point_4, Set=point_6)  # -> Hit, Index
find_similar_member_3 = FindSimilarMember(Data=point_3, Set=point_6)  # -> Hit, Index
cull_index = CullIndex(List=point_6, Indices=[find_similar_member_2.Index, find_similar_member_3.Index], Wrap=True)
support_karamba3d = SupportKaramba(PosInd=cull_index, menu=[buttons(off, on, off, on, off, on)])
support_karamba3d_2 = SupportKaramba(PosInd=find_similar_member_2.Hit, menu=[buttons(on, on, on, on, on, on)])
support_karamba3d_3 = SupportKaramba(PosInd=find_similar_member_3.Hit, menu=[buttons(on, on, on, on, on, on)])
support_karamba3d_4 = SupportKaramba(flatten([support_karamba3d_2, support_karamba3d, support_karamba3d_3]))
support_karamba3d_5 = SupportKaramba(flatten([support_karamba3d_3, support_karamba3d_2]))

# ----
beam_truss_bending = BooleanToggle(True)
beam_bending = BooleanToggle(True)
has_joint = BooleanToggle(True)

# ---- group: Define Elements
# an ideal truss has hinged joints and
#  members carry only axial loads
panel_3 = Panel("beams_truss")
line_to_beam_karamba3d_2 = LineToBeamKaramba3D(Line=curve_4, Identifier=panel_3, New=True, Remove=True, LimitDistance_m=0.005, Bending=beam_truss_bending)  # -> Element, Points, Info

# an ideal truss has hinged joints and
#  members carry only axial loads
panel_4 = Panel("beams")
line_to_beam_karamba3d_3 = LineToBeamKaramba3D(Line=curve_3, Identifier=panel_4, New=True, Remove=True, LimitDistance_m=0.005, Bending=beam_bending)  # -> Element, Points, Info

# ----
cross_section_karamba3d = CrossSectionKaramba3D(
    FamilyNameOfCrossSection="Hey",
    NameOfCrossSection="Yo",
    ElementIdentifier=panel_3,
    Material=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,
    Height_cm=9.6,
    UpperFlangeWidth_cm=10,
    LowerFlangeWidth_cm=10,
    UpperFlangeThickness_cm=0.8,
    LowerFlangeThickness_cm=0.8,
    WebThickness_cm=0.5,
    FilletRadius_cm=0,
    mode="I")
panel_5 = Panel(cross_section_karamba3d)
panel_6 = Panel(line_to_beam_karamba3d_3.Points)
rhino_doc_dir = RhinoDocDir()  # -> rhino_doc_dir
# ---------- rhino_doc_dir: Python ----------
import scriptcontext as sc
from os import path

rhino_doc_dir = path.abspath(path.dirname(sc.doc.Path))
# ---------- end rhino_doc_dir ----------
merge = Merge(Data1=line_to_beam_karamba3d_3.Element, Data2=line_to_beam_karamba3d_2.Element)
ghpython_script = GhPythonScript(x=rhino_doc_dir)  # -> a
# ---------- ghpython_script: Python ----------
import os

a = os.path.join(x, '..', '..', '..', 'tests', 'test_data')
# ---------- end ghpython_script ----------

# ---- group: supports marked as grounded, to differentiate from "2D-stablizing" supports
support_karamba3d_6 = SupportKaramba(flatten(support_karamba3d_5))

# ----
construct_point = ConstructPoint(XCoordinate="0", YCoordinate=Slider(0, range=0..2), ZCoordinate="0")
construct_point_2 = ConstructPoint(XCoordinate="0", YCoordinate=Slider(1.153, range=0..2), ZCoordinate="0")
beam_joints_karamba3d = BeamJointsKaramba3D(
    ElementIdentifiers=panel_4,
    CtKNMAtStartingNode=Vector(0, 0, 0),
    CrKNmRadAtStartingNode=construct_point_2,
    CtKNMAtEndNode=Vector(0, 0, 0),
    CrKNmRadAtEndNode=construct_point_2,
    menu=[buttons(off, off, off, off, off, off), buttons(off, off, off, off, on, off)])
beam_joints_karamba3d_2 = BeamJointsKaramba3D(
    ElementIdentifiers=panel_3,
    CtKNMAtStartingNode=Vector(0, 0, 0),
    CrKNmRadAtStartingNode=construct_point,
    CtKNMAtEndNode=Vector(0, 0, 0),
    CrKNmRadAtEndNode=construct_point,
    menu=[buttons(off, off, off, off, off, off), buttons(off, off, off, off, off, off)])
stream_filter = StreamFilter(Gate=has_joint, Stream1=[beam_joints_karamba3d_2, beam_joints_karamba3d])

# ---- group: Assemble Model
assemble_model_karamba3d = AssembleModelKaramba(
    Point=point_5,
    Elem=merge,
    Support=support_karamba3d_4,
    Load=load_karamba3d,
    CrossSection=cross_section_karamba3d,
    Joint=stream_filter,
    LimitDistance_m=0.005)  # -> Model, Info, Mass_kg, CenterOfGravity

# ----
panel_7 = Panel("D:\code_ws\gh_scritps\karamba\Karamba3D_1_3_2_ScriptingGuideExamples\export_example")
rhino_doc_dir_2 = RhinoDocDir()  # -> rhino_doc_dir; same code as rhino_doc_dir
ghpython_script_2 = GhPythonScript(x=rhino_doc_dir_2)  # -> out, a
# ---------- ghpython_script_2: Python ----------
import os

a = os.path.abspath(os.path.join(x,"..","..",".."))
# ---------- end ghpython_script_2 ----------
k_model = Slider(0, range=0..1)
format_json = BooleanToggle(True)
export_json = BooleanToggle(False)
panel_8 = Panel(ghpython_script_2.a)
concatenate = Concatenate(FragmentA="2D_truss", FragmentB=".json")
disassemble_cross_section_karamba3d = DisassembleCrossSectionKaramba3D(CroSec=cross_section_karamba3d)  # -> CrossSection, FamilyNameOfCrossSection, TypeNameOfCrossSection, ElemIdentifiers, Color, Material, LocalEccentricity_cm, Heights_cm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
model_karamba3d = ModelKaramba3D(assemble_model_karamba3d.Model)
model_karamba3d_2 = ModelKaramba3D(assemble_model_karamba3d.Model)

# ---- group: json to karamba
ghpython_script_3 = GhPythonScript(conmech_dir=ghpython_script_2.a, save_dir=panel_7, file_name=concatenate)  # -> out, Model_out
# ---------- ghpython_script_3: Python ----------
import rhinoscriptsyntax as rs
import Rhino.Geometry.Plane as Plane
import Rhino.Geometry.Point3d as Point3d
import Rhino.Geometry.Vector3d as Vector3d
import Rhino.Geometry.Quaternion as Quat
import Grasshopper.DataTree as DataTree # Add, AddRange(list, GHPath(i, j))
import Grasshopper.Kernel.Data.GH_Path as GHPath
import System
from System.Collections.Generic import List

from ghpythonlib.treehelpers import list_to_tree, tree_to_list
import os
import json
##############################

import clr
# https://ironpython.net/documentation/dotnet/dotnet.html

clr.AddReferenceToFileAndPath("C:\Program Files\Rhino 6\Plug-ins\Karamba.gha")
clr.AddReferenceToFileAndPath("C:\Program Files\Rhino 6\Plug-ins\KarambaCommon.dll")

import feb # Karamba's C++ library (undocumented in the API)
import Karamba.Models.Model as Model
import Karamba.GHopper.Models.GH_Model as GH_Model
#
import Karamba
import Karamba.Elements.ModelTruss as Truss
from Karamba.Geometry import Point3, Line3, Vector3
from Karamba.CrossSections import CroSec
from Karamba.Supports import Support
from Karamba.Loads import Load
#
from Karamba.Utilities import MessageLogger, UnitsConversionFactories
import KarambaCommon
#
import System
from System import GC
from System.Collections.Generic import List

#####################################
# add path to conmech script folder
import os, sys 
sys.path.append(os.path.join(conmech_dir, "src", "pyconmech", "frame_analysis"))
#from io_base import Model
import io_base
import karamba_io
reload(io_base)
reload(karamba_io)
from karamba_io import KarambaNode, KarambaElement, KarambaSupport, KarambaCrossSec, \
    KarambaMaterialIsotropic, KarambaModel
from io_base import LoadCase

#####################################

with open(os.path.join(save_dir, file_name), 'r') as f:
    data = json.load(f)

km = KarambaModel.from_data(data)
lc = LoadCase.from_data(data['loadcases']['0'])

model = km.to_karamba(lc)

# calculate Th.I response
logger = MessageLogger();
k3d = KarambaCommon.Toolkit();
max_disp = clr.Reference[List[float]]()
out_g = clr.Reference[List[float]]()
out_comp = clr.Reference[List[float]]()
message = clr.Reference[str]()
model = k3d.Algorithms.AnalyzeThI(model, max_disp, out_g, out_comp, message);

ucf = UnitsConversionFactories.Conv();
cm = ucf.cm();
print "max disp: {} {}".format(cm.toUnit(max_disp.Value[0]), cm.unitB)

Model_out = Karamba.GHopper.Models.GH_Model(model);

from Karamba.GHopper.CrossSections import GH_CrossSection
a = List[GH_CrossSection]([GH_CrossSection(cs.to_karamba()) for _, cs in km.crosssecs.items()])
# ---------- end ghpython_script_3 ----------

# ---- group: karamba to json export
ghpython_script_4 = GhPythonScript(
    conmech_dir=ghpython_script_2.a,
    k_model=model_karamba3d,
    model_name="2D_truss",
    save_path=panel_7,
    export=export_json,
    format_json=format_json)  # -> out, a; inputs k_grounded_nodes: list
# ---------- ghpython_script_4: Python ----------
import rhinoscriptsyntax as rs
import Rhino.Geometry.Plane as Plane
import Rhino.Geometry.Point3d as Point3d
import Rhino.Geometry.Vector3d as Vector3d
import Rhino.Geometry.Quaternion as Quat
import Grasshopper.DataTree as DataTree # Add, AddRange(list, GHPath(i, j))
import Grasshopper.Kernel.Data.GH_Path as GHPath
import System
from System.Collections.Generic import List

from ghpythonlib.treehelpers import list_to_tree, tree_to_list
import os
import json
##############################

import clr
# https://ironpython.net/documentation/dotnet/dotnet.html

clr.AddReferenceToFileAndPath("C:\Program Files\Rhino 6\Plug-ins\Karamba.gha")
clr.AddReferenceToFileAndPath("C:\Program Files\Rhino 6\Plug-ins\KarambaCommon.dll")

import feb # Karamba's C++ library (undocumented in the API)
import Karamba.Models.Model as Model
import Karamba.GHopper.Models.GH_Model as GH_Model
#
import Karamba
import Karamba.Elements.ModelTruss as Truss
from Karamba.Geometry import Point3, Line3, Vector3
from Karamba.CrossSections import CroSec
from Karamba.Supports import Support
from Karamba.Loads import Load
#
from Karamba.Utilities import MessageLogger, UnitsConversionFactories
import KarambaCommon
#
import System
from System import GC
from System.Collections.Generic import List

#####################################
# add path to conmech script folder
import os, sys 
sys.path.append(os.path.join(conmech_dir, "src", "pyconmech", "frame_analysis"))
#from io_base import Model
import io_base
import karamba_io
reload(io_base)
reload(karamba_io)
from karamba_io import KarambaModel, KarambaLoadCase

#####################################

k_model = KarambaModel.from_karamba(_k_model, grounded_supports=_k_grounded_nodes, \
    model_name=model_name, limit_distance=1e-6)

model_data = k_model.to_data()
lc = 0
k_loadcase = KarambaLoadCase.from_karamba(_k_model, lc=lc)
model_data['loadcases'] = {}
model_data['loadcases'][str(lc)] = k_loadcase.to_data()

with open(os.path.join(save_path, model_name + '.json'), "w") as outfile:
    json.dump(model_data, outfile, indent=1 if format_json else None)
# ---------- end ghpython_script_4 ----------

# ----
panel_9 = Panel(model_karamba3d)
disassemble_model_karamba3d = DisassembleModelKaramba3D(Model=model_karamba3d_2)  # -> Model, Point, Beam, Shell, Support, Load, Line, Mesh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
panel_10 = Panel(model_karamba3d_2)
panel_11 = Panel(disassemble_cross_section_karamba3d.Area_cm2)
panel_12 = Panel(disassemble_cross_section_karamba3d.Iyy_cm4)
panel_13 = Panel(disassemble_cross_section_karamba3d.Izz_cm4)
panel_14 = Panel(disassemble_cross_section_karamba3d.Ipp_cm4)
python_karamba_model_converter = PythonKarambaModelConverter(
    Model_in=ghpython_script_3.Model_out,
    Reference=["C:\Program Files\Rhino 6\Plug-ins\karambaCommon.dll", "C:\Program Files\Rhino 6\Plug-ins\karamba.gha"])  # -> out, flatten(Model_out)
# ---------- python_karamba_model_converter: Python usings ----------
using Karamba.Models;
using Karamba.GHopper.Models;
# ---------- python_karamba_model_converter: Python ----------
    var model = Model_in as Model;
    if (model == null) {
      throw new ArgumentException("The input in 'Model_in' is not of type karamba.Models.Model!");
    }

    Model_out = new GH_Model(model);

    Print("Everything OK");
# ---------- end python_karamba_model_converter ----------
stream_filter_2 = StreamFilter(Gate=k_model, Stream0=assemble_model_karamba3d.Model, Stream1=python_karamba_model_converter.Model_out)

# ---- group: Analyze Model
analyze_karamba3d = AnalyzeKaramba3D(Model=stream_filter_2)  # -> CalculatedModel, MaximumDisplacement_cm, ResultingForceOfGravity_kN, ElasticEnergy_kNm
displacement = Panel(analyze_karamba3d.MaximumDisplacement_cm)

# ----
disassemble_model_karamba3d_2 = DisassembleModelKaramba3D(Model=analyze_karamba3d.CalculatedModel)  # -> Model, Point, Beam, Shell, Support, Load, Line, Mesh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
panel_15 = Panel(disassemble_model_karamba3d_2.Beam)
panel_16 = Panel(analyze_karamba3d.ElasticEnergy_kNm)
model_karamba3d_3 = ModelKaramba3D(python_karamba_model_converter.Model_out)
disassemble_model_karamba3d_3 = DisassembleModelKaramba3D(Model=model_karamba3d_3)  # -> Model, Point, Beam, Shell, Support, Load, Line, Mesh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
panel_17 = Panel(python_karamba_model_converter.Model_out)
panel_18 = Panel(disassemble_cross_section_karamba3d.Material)
disassemble_material_karamba3d = DisassembleMaterialKaramba3D(Material=disassemble_cross_section_karamba3d.Material)  # -> Material, TypeOfMaterial, FamilyNameOfMaterial, NameOfMaterial, ElemIdentifiers, Color, YoungsModulusKNCm2Dir12, InPlaneShearModulus_kN_cm2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
panel_19 = Panel(disassemble_model_karamba3d_3.Beam)
panel_20 = Panel(disassemble_model_karamba3d.Beam)
panel_21 = Panel(model_karamba3d_3)
model_karamba3d_4 = ModelKaramba3D(analyze_karamba3d.CalculatedModel)

# ---- group: Check Beam Internal Forces
# In local axis!
# -You can call a specific group of beams using
# the 'BeamIds' input.
# -Adding '3' to the resolution input provides values
# at the middle of each beam in addition to the
# two ends (default).
beam_forces_karamba3d = BeamForcesKaramba(AnalyzedModel=model_karamba3d_4, LCase=-1, MaximumDistanceBetweenResults_m=-1, NumberOfResultsPerBeamElement=2)  # -> AnalyzedModel, simplify(graft(NormalForce_kN)), simplify(graft(ShearForceVz_kN)), simplify(graft(ShearForceVy_kN)), simplify(graft(BendingMomentMt_kNm)), simplify(graft(BendingMomentMy_kNm)), simplify(graft(BendingMomentMz_kNm))

# ---- group: Check Beam Displacements
# In global axis!
# -You can call a specific group of beams using
# the 'BeamIds' input.
# -Adding '3' to the resolution input provides values
# at the middle of each beam in addition to the
# two ends (default).
beam_displacements_karamba3d = BeamDisplacementsKaramba(AnalyzedModel=model_karamba3d_4, LoadCase=-1, MaximumDistanceBetweenResults_ft=-1, NumberOfResultsPerElement=2)  # -> AnalyzedModel, simplify(graft(Translations_ft)), simplify(graft(Rotations_rad))
concatenate_2 = Concatenate(FragmentA=beam_displacements_karamba3d.Translations_ft, FragmentB=beam_displacements_karamba3d.Rotations_rad)
panel_22 = Panel(concatenate_2)

# ----
reaction_forces_karamba3d = ReactionForcesKaramba3D(AnalyzedModel=model_karamba3d_4, ResultCase=0)  # -> AnalyzedModel, simplify(graft(ReactionForces_kN)), simplify(graft(ReactionMoments_kNm)), SupportPosition, SumOfReactionForces_kN, SumOfReactionMoments_kNm
panel_23 = Panel(reaction_forces_karamba3d.SumOfReactionForces_kN)
panel_24 = Panel(reaction_forces_karamba3d.SumOfReactionMoments_kNm)
panel_25 = Panel(reaction_forces_karamba3d.ReactionForces_kN)
panel_26 = Panel(reaction_forces_karamba3d.ReactionMoments_kNm)

# ---- group: View Results
model_view_karamba3d = ModelViewKaramba3D(Model=analyze_karamba3d.CalculatedModel, LoadCaseFactorsForLinearSuperposition=1, IndexOfVisibleLoadcase=-1)  # -> Model, DeformedMesh, DeformedAxes, DeformedModel
beam_view_karamba3d = BeamViewKaramba3D(Model=model_view_karamba3d.Model)  # -> Model, MeshesOfRenderedBeams, DeformedBeamAxes, LegendColors, LegendTags
legend = Legend(Colour=beam_view_karamba3d.LegendColors, Tags=beam_view_karamba3d.LegendTags, LegendType=1)

# ----
concatenate_3 = Concatenate(
    Fragment_A=beam_forces_karamba3d.NormalForce_kN,
    C=" | ",
    Fragment_B=beam_forces_karamba3d.ShearForceVy_kN,
    A=" | ",
    B=beam_forces_karamba3d.ShearForceVz_kN,
    E=" | ",
    D=beam_forces_karamba3d.BendingMomentMt_kNm,
    F=" | ",
    G=beam_forces_karamba3d.BendingMomentMy_kNm,
    H=" | ",
    I=beam_forces_karamba3d.BendingMomentMz_kNm)
panel_27 = Panel(concatenate_3)
concatenate_4 = Concatenate(FragmentA=reaction_forces_karamba3d.ReactionForces_kN, FragmentB=panel_26)
panel_28 = Panel(concatenate_4)
